# Grasshopper definition 0001 ARRAY3D.gh (Grasshopper 1.0.7)
# plug-ins: Pufferfish, EleFront, Wombat, Human

doc_units = DocumentUnits()
panel = Panel(doc_units)
# MOVE GEOMETRY TO 3D PT GRID
number_slider = Slider(144, range=0..1000)
# MULTIPLE POINT ATTRACTORS
# UNDULATING SURFACE
pipeline = GeometryPipeline(
    GroupByLayer=False,
    GroupByType=False,
    IncludeHidden=True,
    IncludeLocked=True,
    LayerFilter="Layer 01",
    NameFilter="*",
    SublayerFiltering=True,
    TypeFilter=1073741848)
num = Number(number_slider)
num_2 = Number(Slider(10, range=0..100))
num_3 = Number(Slider(6, range=0..100))
num_4 = Number(Slider(6, range=0..100))
series = Series(Start=0, Step=num, Count=num_3)
series_2 = Series(Start=0, Step=num, Count=num_4)
series_3 = Series(Start=0, Step=num, Count=num_2)
bbox = BoundingBox(Content=pipeline, Plane=PlaneXY(0, 0, 0))  # -> Box, Box_2
pdecon = Deconstruct()  # -> XComponent, YComponent, ZComponent
# SELECT MULTIPLE INDICES IN A LIST
edges = BrepEdges()  # -> Naked, Interior, NonManifold
boxprop = BoxProperties(Box=bbox.Box)  # -> Center, Diagonal, Area, Volume, Degeneracy
debox = DeconstructBox(Box=bbox.Box)  # -> Plane, X, Y, Z
debrep = DeconstructBrep(Brep=bbox.Box)  # -> Faces, Edges, Vertices
crossref = CrossReference(ListA=series_3, ListB=series_2, ListC=series, CrossMode=1)  # -> ListA, ListB, ListC
panel_2 = Panel(debrep.Vertices)
item = ListItem(List=debrep.Vertices, Index="0", Wrap=True)
item_2 = ListItem(List=debrep.Vertices, Index="1", Wrap=True)
item_3 = ListItem(List=debrep.Vertices, Index="4", Wrap=True)
pt = Point(debrep.Vertices)
pt_2 = ConstructPoint(XCoordinate=crossref.ListA, YCoordinate=crossref.ListB, ZCoordinate=crossref.ListC)
dist = Distance(PointA=item, PointB=item_2)
dist_2 = Distance(PointA=item, PointB=item_3)
points = PointList(Points=pt, Size=Slider(10, range=0..10))
volume = Volume(Geometry=pipeline)  # -> Volume, Centroid

pt_3 = Point(<point referenced from the Rhino model>)  # disabled
number_slider_2 = Slider(0.0307, range=0..0.1)  # disabled
vec2pt = Vector2Pt(PointA=pt_3, PointB=pt_2, Unitize=False)  # -> Vector, Length; disabled
multiplication = Multiplication(A=vec2pt.Vector, B=number_slider_2)  # disabled
box = DomainBox(Base=pt_2, X=multiplication, Y=multiplication, Z=multiplication)  # disabled

# ---- group: RANDOM REDUCE
number_slider_3 = Slider(80, range=0..100)  # disabled
reduce = RandomReduce(List=pt_2, Reduction=number_slider_3, Seed=1)  # disabled

# ----
panel_3 = Panel(dist)
pt_4 = Point(<point referenced from the Rhino model>)
panel_4 = Panel(dist_2)
pt_5 = Point(pt_2)
pt_6 = Point(<point referenced from the Rhino model>)
pt_7 = Point(<point referenced from the Rhino model>)
dist_3 = Distance(PointA=pt_5, PointB=pt_7)
smaller = SmallerThan(FirstNumber=dist_3, SecondNumber=Slider(250, range=0..1000))  # -> SmallerThan, OrEqualTo
dispatch = Dispatch(List=pt_5, DispatchPattern=smaller.OrEqualTo)  # -> ListA, ListB
pt_8 = Point(dispatch.ListB)
dist_4 = Distance(PointA=pt_8, PointB=pt_6)
smaller_2 = SmallerThan(FirstNumber=dist_4, SecondNumber=Slider(250, range=0..1000))  # -> SmallerThan, OrEqualTo
dispatch_2 = Dispatch(List=pt_8, DispatchPattern=smaller_2.OrEqualTo)  # -> ListA, ListB
pt_9 = Point(dispatch_2.ListA)
pt_10 = Point(dispatch_2.ListB)
dist_5 = Distance(PointA=pt_10, PointB=pt_4)
smaller_3 = SmallerThan(FirstNumber=dist_5, SecondNumber=Slider(250, range=0..1000))  # -> SmallerThan, OrEqualTo
dispatch_3 = Dispatch(List=pt_10, DispatchPattern=smaller_3.OrEqualTo)  # -> ListA, ListB
pt_11 = Point(dispatch_3.ListA)
pt_12 = Point(dispatch_3.ListB)
pt_13 = Point(dispatch.ListA)
attributes = DefineObjectAttributes(Layer="OPTION 3")
pt_14 = Point(pt_12)
move2pt = MoveToPoint(Geometry=pipeline, PointA=volume.Centroid, PointB=pt_14)  # -> Moved, Vector, Transform; disabled
preview = CustomPreview(Geometry=move2pt.Moved, Material=ColourSwatch(SwatchColor=RGB(71, 71, 71)))
bake = BakeObjects(Geometry=move2pt.Moved, Attributes=attributes, Bake=Button())

# ----
# HOW TO UTILIZE MULTI DISPATCH
mdispatch = DispatchMultiple(DispatchPattern=smaller.OrEqualTo, List0=pt_2, List1=pt_8, List2=pt_10)  # -> List0, List1, List2, List3; disabled
pt_15 = Point(mdispatch.List1)  # disabled
pt_16 = Point(mdispatch.List0)  # disabled
_0 = Point(mdispatch.List2)  # disabled
